# Grasshopper definition example.gh (Grasshopper 1.0.7)
# plug-ins: THERB

brep = Brep([<brep referenced from the Rhino model> x3])
srf = Surface([<surface referenced from the Rhino model> x2])
therb = THERB(Geometries=brep, Windows=srf, Tolerance=Slider(0.1, range=0..0.1))  # -> Rooms, Faces, Windows, Baues
list = ValueList({"明色": 0, "黒": 1, "コンクリート": 3, "中等色": 4, "白タイル": 5, "光沢　アルミ": 6, "白ペイント": 7}, selected="明色")
panel = Panel(therb.Baues)
